# Grasshopper definition ex3_compas_assembly_send_to_app.ghx (Grasshopper 1.0.7)

# ----
# Rhino to App
# All arrows that need to be visualized are published via a ROS topic OPTIONS
publish_rhino_options = BooleanToggle(True)  # disabled
publish = PythonScript(publish_topic=publish_rhino_options)  # -> out; disabled
# ---------- publish: Python ----------
import logging
from roslibpy import Topic
from roslibpy import ServiceRequest
from roslibpy import Service
from scriptcontext import sticky

LOGGER = logging.getLogger('roslibpy')


#key = 'publisher_%s' % str(ghenv.Component.InstanceGuid)

key = 'publisher_options'
#print key

if publish_topic:
    #print("publish")
    if ros_client and ros_client.is_connected:
        print("published topic")
        publisher = Topic(ros_client, '/incon/arrows_to_draw', 'std_msgs/Float32MultiArray')
        sticky[key] = publisher
    else:
        sticky[key] = None
else:
    sticky[key] = None
# ---------- end publish ----------
panel = Panel(publish)  # disabled

# ----
# 1.
bang = Button()
panel_2 = Panel("Unload libraries")
unload = PythonScript(bang=bang)
# ---------- unload: Python ----------
from compas_rhino.utilities.misc import get_tolerance
from compas_rhino.utilities.misc import unload_modules

unload_modules("compas")
unload_modules("assembly_information_model")
# ---------- end unload ----------

# ----
# ROS - Settings
list = ValueList({"local": 0, "linux computer": 1}, selected="local")

# ---- group: ROS client
restart = Button()
disconnect = Button()
connect = Button()
ros = PythonScript(restart=restart, connection=list)  # -> ros_client
# ---------- ros: Python ----------
import time
import logging
import scriptcontext as sc

from roslibpy import Ros
from System import TimeSpan
from System.Threading import ManualResetEventSlim

LOGGER = logging.getLogger('roslibpy')

guid = str(ghenv.Component.InstanceGuid)
ros_client_key = "rosclient_" + guid

previous_client = sc.sticky.get(ros_client_key, None)
if previous_client:
    previous_client.terminate()

if connection == 0: #local
    ros_client = Ros('127.0.0.1', 9090) #local, own laptop
elif connection == 1: # linux computer
    ros_client = Ros('192.168.2.139', 9090) #mabi computer - lan
sc.sticky[ros_client_key] = ros_client

waitLock = ManualResetEventSlim(False) 
ros_client.on_ready(lambda: waitLock.Set()) 

if not waitLock.Wait(TimeSpan.FromSeconds(5)):
    raise Exception('Unable to connect to ROS')

LOGGER.info('ROS connection opened')
# ---------- end ros ----------
connect_2 = PythonScript(ros_client=ros, connect=connect, disconnect=disconnect)  # -> out, ros_client
# ---------- connect_2: Python ----------
import logging
from System import TimeSpan
from System.Threading import ManualResetEventSlim

LOGGER = logging.getLogger('roslibpy')

if connect:
    if not ros_client.is_connected:
        LOGGER.debug('Connecting...')
        waitLock = ManualResetEventSlim(False)
        ros_client.on_ready(lambda: waitLock.Set())
        ros_client.connect()

        if not waitLock.Wait(TimeSpan.FromSeconds(5)):
            raise Exception('Unable to connect to ROS')
        LOGGER.debug('Reconnected')

if disconnect:
    if ros_client.is_connected:
        ros_client.terminate()
        LOGGER.debug('Terminated')
        
       
if (ros_client.is_connected):
    print('connected')
else:
    print('disconnected')
# ---------- end connect_2 ----------
panel_3 = Panel(connect_2.out)

# ----
# Element
# Predefine an element and its dimensions
# Visualise the defined element
show = BooleanToggle(False)
# 2.a
# Assembly Example
elem_def = GhPythonScript()  # -> out, elem
# ---------- elem_def: Python ----------
import os
import sys
import json

from compas.geometry import Frame
from compas.geometry import Vector
from compas.geometry import Box

from assembly_information_model.assembly import Element

# dimensions
width = 0.048
length = 0.40
height = 0.024

# element
box_frame = Frame([0., 0., 0.], [1, 0, 0], [0, 1, 0]) #center of the box frame 
box = Box(box_frame, length, width, height) 
tool_frame = Frame([0, 0, height/2.0], [1, 0, 0], [0, -1, 0])
elem = Element.from_shape(box, tool_frame)
# ---------- end elem_def ----------
draw = PythonScript(elem=elem_def.elem, show=show)  # -> M, F, S
# ---------- draw: Python ----------
import os
from compas.geometry import Transformation
from compas.geometry import Frame
from compas.datastructures import mesh_transformed
from compas_ghpython.artists import MeshArtist
from compas_ghpython import draw_frame

if show:
    artist = MeshArtist(elem.mesh)
    M = artist.draw()
    F = draw_frame(elem.frame)
    S = draw_frame(elem._source.frame)
# ---------- end draw ----------
mesh = Mesh(draw.M)
preview = CustomPreview(Geometry=mesh, Shader=ColourSwatch(SwatchColor=RGBA(255, 227, 227, 233)))

# ----
# Assembly
toggle = BooleanToggle(False)
cp = Plane(PlaneXY(0.4, 0.4, 0))
cp_new = Plane(PlaneXY(0.8, 0.4, 0))
generate_assembly = GhPythonScript(centerplane=cp, elem=elem_def.elem, transform=toggle, ptransf=cp_new)  # -> assembly, planes; inputs ptransf: Plane
# ---------- generate_assembly: Python ----------
import Rhino.Geometry as rg
import math
from scriptcontext import sticky as st


from compas.geometry import Frame
from compas.geometry import Transformation
from compas.geometry import Rotation
from compas.geometry import Translation
from compas.geometry import Point

from compas_ghpython import draw_frame

from assembly_information_model.assembly import Assembly
from assembly_information_model.assembly import Element

import Rhino.Geometry as rg


# initialize an empty assembly class
assembly = Assembly()

planes = [] # just for vizualisation

#cp.Rotate(math.radians(90), cp.ZAxis, cp.Origin)
#cp.Translate(rg.Vector3d(0,0,1))
cp = centerplane
cf = Frame(cp.Origin, cp.XAxis, cp.YAxis)


for i in range(25): # loop through the number of layers i
    
    axis = cf.zaxis
    angle = math.radians(i*3)
    
    R = Rotation.from_axis_and_angle(axis, angle, point=cp.Origin) #Calculates a ``Rotation`` from a rotation axis and an angle and an optional point of rotation.
    T = Translation.from_vector([0,0,0.024*i])
   

    cft = cf.transformed(R * T) #transforms the origin plane

    if i%2 == 0: 
        R = Rotation.from_axis_and_angle(cft.zaxis, math.radians(90), point=cft.point)
        cft = cft.transformed(R)
       
    add = math.sin(i/5)*0.015
    #print(add)
    
    o1 = cft.point + cft.yaxis*(0.1+add)
    o2 = cft.point - cft.yaxis*(0.1+add)
    
    f1 = Frame(o1, cft.xaxis, cft.yaxis)
    f2 = Frame(o2, cft.xaxis, cft.yaxis)
    
    planes.append(draw_frame(f1))
    planes.append(draw_frame(f2))
    
    T1 = Transformation.from_frame_to_frame(Frame.worldXY(), f1)
    T2 = Transformation.from_frame_to_frame(Frame.worldXY(), f2)
    
    #T1 = Translation([10,2,3])
    
    # create new instances of the element
    new_elem_1 = elem.transformed(T1) #returns a deep copy of the initial element at the new location of the frame
    new_elem_2 = elem.transformed(T2)

    assembly.add_element(new_elem_1)
    assembly.add_element(new_elem_2)


if transform:
    T = Transformation.from_frame_to_frame(cf, Frame(ptransf.Origin, ptransf.XAxis, ptransf.YAxis))
    assembly.transform(T)


for key, element in assembly.elements():
    print(element.tool_frame)
# ---------- end generate_assembly ----------
pln = Plane(generate_assembly.planes)

# ----
# Export
# Export a building element as an .obj file in the data folder of the repository.
panel_4 = Panel("example_element_1.obj")
py = PythonScript()  # -> HERE, DATA
# ---------- py: Python ----------
import os
from scriptcontext import sticky as st

HERE = os.path.dirname(ghdoc.Path)
DATA = os.path.abspath(os.path.join(HERE, "..", "data"))
print(HERE)
print(DATA)

st.clear()
st['DATA_PATH'] = DATA
# ---------- end py ----------
export = GhPythonScript(DATA=py.DATA, elem=elem_def.elem, filename=panel_4, export_to_obj=Button())  # inputs export_to_obj: Boolean
# ---------- export: Python ----------
import os

if export_to_obj:
    elem.mesh.quads_to_triangles(check_angles=False)
    #filename = "element_example.obj"
    PATH = os.path.join(DATA, filename)
    elem.mesh.to_obj(PATH, precision=None, unweld=False)
# ---------- end export ----------

back = Button()
reset = Button()
start = Button()
stop = Button()
step = Button()
full = Button()
list_2 = ValueList({"20", "50", "100", "500", "1000", "5000"}, selected="50")

# ----
# Draw
counter = CountThroughList(
    assembly=generate_assembly.assembly,
    start=start,
    stop=stop,
    step=step,
    step_back=back,
    reset=reset,
    full=full,
    interval=list_2)  # -> item, counter; inputs start: Boolean, stop: Boolean, step_back: Boolean
# ---------- counter: Python ----------
from scriptcontext import sticky as st
from compas_ghpython import update_component


L = list(assembly.elements())
# store data in component
guid = str(ghenv.Component.InstanceGuid)
counter_key = "counter_" + guid
running_key = "running_" + guid

if counter_key not in st:
    st[counter_key] = 0

if running_key not in st:
    st[running_key] = False
    

if st[running_key]:
    if st[counter_key] < len(L) - 1:
        st[counter_key] += 1
        update_component(ghenv, interval)
    else:
        st[counter_key] = 0
        st[running_key] = False
    
    
if start:
    st[running_key] = True

if stop:
    st[running_key] = False

if step:
    if st[counter_key] < len(L) - 1:
        st[counter_key] += 1

if step_back:
    if st[counter_key] < len(L):
        st[counter_key] -= 1

if reset:
    st[counter_key] = 0

if full:
    st[counter_key] = len(L)-1

if len(L):
    item = L[st[counter_key]]



#st["visualisation_counter"] = st[counter_key]
counter = st[counter_key]
# ---------- end counter ----------
show_2 = BooleanToggle(True)
show_3 = BooleanToggle(True)
idx = Panel(counter.counter)
draw_2 = PythonScript(assembly=generate_assembly.assembly, show_all=show_2, show_counter=show_3, counter=idx)  # -> G, origin_planes_WCS, current_origin_plane; inputs counter: Int32
# ---------- draw_2: Python ----------
import os
import sys

import math

from compas_ghpython.artists import MeshArtist
from compas_ghpython import draw_frame


G = []

key_index = assembly.network.key_index()
keys = [key_index[key] for key in assembly.network.nodes()]
elements = [assembly.element(key) for key in keys]
#print elements
#print([(e.gripping_frame) for e in elements])

origin_planes_WCS = [draw_frame(e.frame) for e in elements]

current_origin_plane = origin_planes_WCS[counter]

if show_all and not show_counter:
    for element in elements:
        artist = MeshArtist(element.mesh)
        mesh = artist.draw()
        G.append(mesh)

if show_counter:
    for element in elements[0:counter+1]:
        artist = MeshArtist(element.mesh)
        mesh = artist.draw()
        G.append(mesh)
    origin_planes_WCS = [draw_frame(e.frame) for e in elements[0:counter+1]]
# ---------- end draw_2 ----------
geo = Geometry(draw_2.G)
pln_2 = Plane(draw_2.origin_planes_WCS)
pln_3 = Plane(draw_2.current_origin_plane)
# 3.
preview_2 = CustomPreview(Geometry=geo, Shader=ColourSwatch(SwatchColor=RGBA(255, 227, 227, 233)))
preview_3 = CustomPreview(Geometry=[pln_2, pln_3], Shader=ColourSwatch(SwatchColor=RGBA(209, 27, 27, 178)))

# ----
# Rhino to App:
# Service: ADD Building Steps
number_slider = Slider(7, range=0..10)
ros_service_request = PythonScript(
    ros_client=connect_2.ros_client,
    assembly=generate_assembly.assembly,
    object_type="example_element_1",
    num_built_elems=number_slider,
    send=Button())  # -> out, assembly, bang; inputs num_built_elems: Int32, send: Boolean
# ---------- ros_service_request: Python ----------
import logging
import roslibpy
from roslibpy import Topic
from roslibpy import ServiceRequest
from roslibpy import Service
from roslibpy import Message
from scriptcontext import sticky


LOGGER = logging.getLogger('roslibpy') 


def ros_msg_add_building_steps():
    ros_msg = {}
    building_steps = []
    for key, element, data in assembly.elements(data=True):
        x,y,z,qw,qx,qy,qz = element.tool_frame_pose_quaternion
        if key < num_built_elems:
            is_already_built = True  #data['is_placed']
        else:
            is_already_built = False
        building_steps.append({'pose': {'orientation': {'z': qz, 'y': qy, 'x': qx, 'w': qw}, 'position': {'z': z, 'y': y, 'x': x}},'object_type': object_type, 'is_already_built': is_already_built})
    ros_msg['building_steps'] = building_steps
    return ros_msg


if send:
    print("send")
    if ros_client:
            message = ros_msg_add_building_steps() #geometry_msgs/PoseStamped[] 
            #message = handle_add_two_bricks()[0] #geometry_msgs/PoseStamped[] 
            #print (message)                
            service_name = '/incon/add_building_steps'
            service_type = '/incon_msgs/add_building_steps'
            service = roslibpy.Service(ros_client, service_name, service_type)
            request = ServiceRequest(message)
            result = service.call(request, timeout=1) #sending of message
            #print(result)
            sticky['result_add_objects'] = result
            
            
            if result:
                # set the frame_id as received from the app
                is_added, num_building_steps_added = (result['success'], result['num_building_steps_added'])
                print(is_added)
                print(num_building_steps_added)
                    
                bang = True if result['success'] == True else False

if 'result_add_objects' in sticky:
    print sticky['result_add_objects']
# ---------- end ros_service_request ----------
panel_5 = Panel(ros_service_request.out)
