# Grasshopper definition ex4_rhino_assembly_send_to_app.ghx (Grasshopper 1.0.7)

# ----
# 1.
bang = Button()
panel = Panel("Unload libraries")
unload = PythonScript(bang=bang)
# ---------- unload: Python ----------
from compas_rhino.utilities.misc import get_tolerance
from compas_rhino.utilities.misc import unload_modules

unload_modules("compas")
unload_modules("assembly_information_model")
# ---------- end unload ----------

# ----
# 2.
# Assembly Example
number_slider = Slider(8, range=0..10)
crv = Curve(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)
divide = DivideCurve(Curve=crv, Count=number_slider, Kinks=False)  # -> Points, Tangents, Parameters
Z = UnitZ(Factor=1)
xprod = CrossProduct(VectorA=divide.Tangents, VectorB=Z, Unitize=False)  # -> Vector, Length
pl = ConstructPlane(Origin=divide.Points, XAxis=xprod.Vector, YAxis=Vector(0, 1, 0))
box = CenterBox(Base=pl, X="0.05", Y="0.05", Z="0.05")

# ----
# ROS - Settings
list = ValueList({"local": 0, "linux computer": 1}, selected="linux computer")

# ---- group: ROS client
restart = Button()
disconnect = Button()
connect = Button()
ros = PythonScript(restart=restart, connection=list)  # -> ros_client
# ---------- ros: Python ----------
import time
import logging
import scriptcontext as sc

from roslibpy import Ros
from System import TimeSpan
from System.Threading import ManualResetEventSlim

LOGGER = logging.getLogger('roslibpy')

guid = str(ghenv.Component.InstanceGuid)
ros_client_key = "rosclient_" + guid

previous_client = sc.sticky.get(ros_client_key, None)
if previous_client:
    previous_client.terminate()

if connection == 0: #local
    ros_client = Ros('127.0.0.1', 9090) #local, own laptop
elif connection == 1: # linux computer
    ros_client = Ros('192.168.2.106', 9090) #mabi computer - lan
sc.sticky[ros_client_key] = ros_client

waitLock = ManualResetEventSlim(False) 
ros_client.on_ready(lambda: waitLock.Set()) 

if not waitLock.Wait(TimeSpan.FromSeconds(5)):
    raise Exception('Unable to connect to ROS')

LOGGER.info('ROS connection opened')
# ---------- end ros ----------
connect_2 = PythonScript(ros_client=ros, connect=connect, disconnect=disconnect)  # -> out, ros_client
# ---------- connect_2: Python ----------
import logging
from System import TimeSpan
from System.Threading import ManualResetEventSlim

LOGGER = logging.getLogger('roslibpy')

if connect:
    if not ros_client.is_connected:
        LOGGER.debug('Connecting...')
        waitLock = ManualResetEventSlim(False)
        ros_client.on_ready(lambda: waitLock.Set())
        ros_client.connect()

        if not waitLock.Wait(TimeSpan.FromSeconds(5)):
            raise Exception('Unable to connect to ROS')
        LOGGER.debug('Reconnected')

if disconnect:
    if ros_client.is_connected:
        ros_client.terminate()
        LOGGER.debug('Terminated')
        
       
if (ros_client.is_connected):
    print('connected')
else:
    print('disconnected')
# ---------- end connect_2 ----------
panel_2 = Panel(connect_2.out)

# ----
# Assembly
mesh = Mesh(box)
create_assembly = GhPythonScript(rmeshes=mesh, planes=pl)  # -> assembly; inputs rmeshes: list of Mesh, planes: list of Plane
# ---------- create_assembly: Python ----------
from compas_rhino.geometry import RhinoMesh
from compas.datastructures import Mesh

from compas_ghpython.artists import MeshArtist

from assembly_information_model.assembly import Element
from assembly_information_model.assembly import Assembly
from compas.geometry import Frame

assembly = Assembly()

for rmesh, plane in zip(rmeshes,planes):
    cmesh = RhinoMesh.from_geometry(rmesh).to_compas()
    #print cmesh
    tool_frame = Frame(plane.Origin, plane.XAxis, plane.YAxis)
    elem = Element.from_mesh(cmesh, tool_frame)
    assembly.add_element(elem)
# ---------- end create_assembly ----------

back = Button()
reset = Button()
start = Button()
stop = Button()
step = Button()
full = Button()
list_2 = ValueList({"20", "50", "100", "500", "1000", "5000"}, selected="50")

# ----
# Draw
counter = CountThroughList(assembly=create_assembly, start=start, stop=stop, step=step, step_back=back, reset=reset, full=full, interval=list_2)  # -> item, counter; inputs start: Boolean, stop: Boolean, step_back: Boolean
# ---------- counter: Python ----------
from scriptcontext import sticky as st
from compas_ghpython import update_component


L = list(assembly.elements())
# store data in component
guid = str(ghenv.Component.InstanceGuid)
counter_key = "counter_" + guid
running_key = "running_" + guid

if counter_key not in st:
    st[counter_key] = 0

if running_key not in st:
    st[running_key] = False
    

if st[running_key]:
    if st[counter_key] < len(L) - 1:
        st[counter_key] += 1
        update_component(ghenv, interval)
    else:
        st[counter_key] = 0
        st[running_key] = False
    
    
if start:
    st[running_key] = True

if stop:
    st[running_key] = False

if step:
    if st[counter_key] < len(L) - 1:
        st[counter_key] += 1

if step_back:
    if st[counter_key] < len(L):
        st[counter_key] -= 1

if reset:
    st[counter_key] = 0

if full:
    st[counter_key] = len(L)-1

if len(L):
    item = L[st[counter_key]]



#st["visualisation_counter"] = st[counter_key]
counter = st[counter_key]
# ---------- end counter ----------
show = BooleanToggle(True)
show_2 = BooleanToggle(False)
idx = Panel(counter.counter)
draw = PythonScript(assembly=create_assembly, show_all=show, show_counter=show_2, counter=idx)  # -> G, origin_planes_WCS, current_origin_plane; inputs counter: Int32
# ---------- draw: Python ----------
import os
import sys

import math

from compas_ghpython.artists import MeshArtist
from compas_ghpython import draw_frame


G = []

key_index = assembly.network.key_index()
keys = [key_index[key] for key in assembly.network.nodes()]
elements = [assembly.element(key) for key in keys]
#print elements
#print([(e.gripping_frame) for e in elements])

origin_planes_WCS = [draw_frame(e.frame) for e in elements]

current_origin_plane = origin_planes_WCS[counter]

if show_all and not show_counter:
    for element in elements:
        artist = MeshArtist(element.mesh)
        mesh = artist.draw()
        G.append(mesh)

if show_counter:
    for element in elements[0:counter+1]:
        artist = MeshArtist(element.mesh)
        mesh = artist.draw()
        G.append(mesh)
    origin_planes_WCS = [draw_frame(e.frame) for e in elements[0:counter+1]]
# ---------- end draw ----------
pln = Plane(draw.origin_planes_WCS)
pln_2 = Plane(draw.current_origin_plane)
geo = Geometry(draw.G)
preview = CustomPreview(Geometry=geo, Shader=ColourSwatch(SwatchColor=RGBA(255, 227, 227, 233)))
preview_2 = CustomPreview(Geometry=[pln, pln_2], Shader=ColourSwatch(SwatchColor=RGBA(209, 27, 27, 178)))

# ----
# Rhino to App:
# Service: ADD Building Steps
number_slider_2 = Slider(7, range=0..10)
# 3.
panel_3 = Panel("example_element_1")
ros_service_request = PythonScript(
    ros_client=connect_2.ros_client,
    assembly=create_assembly,
    object_type=panel_3,
    num_built_elems=number_slider_2,
    send=Button())  # -> out, assembly, bang; inputs num_built_elems: Int32, send: Boolean
# ---------- ros_service_request: Python ----------
import logging
import roslibpy
from roslibpy import Topic
from roslibpy import ServiceRequest
from roslibpy import Service
from roslibpy import Message
from scriptcontext import sticky


LOGGER = logging.getLogger('roslibpy') 


def ros_msg_add_building_steps():
    ros_msg = {}
    building_steps = []
    for key, element, data in assembly.elements(data=True):
        x,y,z,qw,qx,qy,qz = element.tool_frame_pose_quaternion
        if key < num_built_elems:
            is_already_built = True  #data['is_placed']
        else:
            is_already_built = False
        building_steps.append({'pose': {'orientation': {'z': qz, 'y': qy, 'x': qx, 'w': qw}, 'position': {'z': z, 'y': y, 'x': x}},'object_type': object_type, 'is_already_built': is_already_built})
    ros_msg['building_steps'] = building_steps
    return ros_msg


if send:
    print("send")
    if ros_client:
            message = ros_msg_add_building_steps() #geometry_msgs/PoseStamped[] 
            #message = handle_add_two_bricks()[0] #geometry_msgs/PoseStamped[] 
            #print (message)                
            service_name = '/incon/add_building_steps'
            service_type = '/incon_msgs/add_building_steps'
            service = roslibpy.Service(ros_client, service_name, service_type)
            request = ServiceRequest(message)
            result = service.call(request, timeout=1) #sending of message
            #print(result)
            sticky['result_add_objects'] = result
            
            
            if result:
                # set the frame_id as received from the app
                is_added, num_building_steps_added = (result['success'], result['num_building_steps_added'])
                print(is_added)
                print(num_building_steps_added)
                    
                bang = True if result['success'] == True else False

if 'result_add_objects' in sticky:
    print sticky['result_add_objects']
# ---------- end ros_service_request ----------
panel_4 = Panel(ros_service_request.out)

# ----
# Visualise the defined element
panel_5 = Panel("0.05")
show_3 = BooleanToggle(True)
box_2 = CenterBox(Base=PlaneXY(0, 0, 0), X=panel_5, Y=panel_5, Z=panel_5)

# ----
# Element
mesh_2 = Mesh(box_2)
pln_3 = Plane(PlaneXY(0, 0, 0))
python = GhPythonScript(rmesh=mesh_2, center_plane=pln_3)  # -> out, elem; inputs rmesh: Mesh
# ---------- python: Python ----------
from compas_rhino.geometry import RhinoMesh
from compas.datastructures import Mesh

from compas_ghpython.artists import MeshArtist

from assembly_information_model.assembly import Element
from compas.geometry import Frame



cmesh = RhinoMesh.from_geometry(rmesh).to_compas()
#print cmesh
tool_frame = Frame(center_plane.Origin, center_plane.XAxis, center_plane.YAxis)
elem = Element.from_mesh(cmesh, tool_frame)

print(elem.tool_frame)
# ---------- end python ----------

draw_2 = PythonScript(elem=python.elem, show=show_3)  # -> M, F, S
# ---------- draw_2: Python ----------
import os
from compas.geometry import Transformation
from compas.geometry import Frame
from compas.datastructures import mesh_transformed
from compas_ghpython.artists import MeshArtist
from compas_ghpython import draw_frame

if show:
    artist = MeshArtist(elem.mesh)
    M = artist.draw()
    F = draw_frame(elem.frame)
# ---------- end draw_2 ----------
preview_3 = CustomPreview(Geometry=draw_2.M, Shader=ColourSwatch(SwatchColor=RGBA(255, 227, 227, 233)))

# ----
# Export rhino mesh
panel_6 = Panel("example_element_2.obj")
py = PythonScript()  # -> HERE, DATA
# ---------- py: Python ----------
import os
from scriptcontext import sticky as st

HERE = os.path.dirname(ghdoc.Path)
DATA = os.path.abspath(os.path.join(HERE, "..", "data"))
print(HERE)
print(DATA)

st.clear()
st['DATA_PATH'] = DATA
# ---------- end py ----------
export = GhPythonScript(DATA=py.DATA, elem=python.elem, filename=panel_6, export_to_obj=Button())  # inputs export_to_obj: Boolean
# ---------- export: Python ----------
import os

if export_to_obj:
    elem.mesh.quads_to_triangles(check_angles=False)
    #filename = "element_example.obj"
    PATH = os.path.join(DATA, filename)
    elem.mesh.to_obj(PATH, precision=None, unweld=False)
# ---------- end export ----------
