# Grasshopper definition ex5_app_publish_pose_to_rhino.ghx (Grasshopper 1.0.7)

# ----
# 1.
bang = Button()
panel = Panel("Unload libraries")
unload = PythonScript(bang=bang)
# ---------- unload: Python ----------
from compas_rhino.utilities.misc import get_tolerance
from compas_rhino.utilities.misc import unload_modules

unload_modules("compas")
unload_modules("assembly_information_model")
# ---------- end unload ----------

# ----
# 2.
# Assembly Example
number_slider = Slider(6, range=0..10)
crv = Curve(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)
divide = DivideCurve(Curve=crv, Count=number_slider, Kinks=False)  # -> Points, Tangents, Parameters
Z = UnitZ(Factor=1)
xprod = CrossProduct(VectorA=divide.Tangents, VectorB=Z, Unitize=False)  # -> Vector, Length
pl = ConstructPlane(Origin=divide.Points, XAxis=xprod.Vector, YAxis=Vector(0, 1, 0))

# ----
# ROS - Settings
list = ValueList({"local": 0, "linux computer": 1}, selected="local")

# ---- group: ROS client
restart = Button()
disconnect = Button()
connect = Button()
ros = PythonScript(restart=restart, connection=list)  # -> ros_client
# ---------- ros: Python ----------
import time
import logging
import scriptcontext as sc

from roslibpy import Ros
from System import TimeSpan
from System.Threading import ManualResetEventSlim

LOGGER = logging.getLogger('roslibpy')

guid = str(ghenv.Component.InstanceGuid)
ros_client_key = "rosclient_" + guid

previous_client = sc.sticky.get(ros_client_key, None)
if previous_client:
    previous_client.terminate()

if connection == 0: #local
    ros_client = Ros('127.0.0.1', 9090) #local, own laptop
elif connection == 1: # linux computer
    ros_client = Ros('192.168.2.106', 9090) #mabi computer - lan
sc.sticky[ros_client_key] = ros_client

waitLock = ManualResetEventSlim(False) 
ros_client.on_ready(lambda: waitLock.Set()) 

if not waitLock.Wait(TimeSpan.FromSeconds(5)):
    raise Exception('Unable to connect to ROS')

LOGGER.info('ROS connection opened')
# ---------- end ros ----------
connect_2 = PythonScript(ros_client=ros, connect=connect, disconnect=disconnect)  # -> out, ros_client
# ---------- connect_2: Python ----------
import logging
from System import TimeSpan
from System.Threading import ManualResetEventSlim

LOGGER = logging.getLogger('roslibpy')

if connect:
    if not ros_client.is_connected:
        LOGGER.debug('Connecting...')
        waitLock = ManualResetEventSlim(False)
        ros_client.on_ready(lambda: waitLock.Set())
        ros_client.connect()

        if not waitLock.Wait(TimeSpan.FromSeconds(5)):
            raise Exception('Unable to connect to ROS')
        LOGGER.debug('Reconnected')

if disconnect:
    if ros_client.is_connected:
        ros_client.terminate()
        LOGGER.debug('Terminated')
        
       
if (ros_client.is_connected):
    print('connected')
else:
    print('disconnected')
# ---------- end connect_2 ----------
panel_2 = Panel(connect_2.out)

# ----
back = Button()
reset = Button()
start = Button()
stop = Button()
step = Button()
full = Button()
list_2 = ValueList({"20", "50", "100", "500", "1000", "5000"}, selected="50")

start_timer = Button()
stop_timer = Button()
bang_2 = Button()

# ----
# 4.
# App to Rhino:
# Subscribe to topic OBJECT POSES
subscribe_incon_object_pose = BooleanToggle(False)
subscribe = PythonScript(ros_client=ros, subscribe_to_topic=subscribe_incon_object_pose)  # -> out; inputs subscribe_to_topic: Boolean
# ---------- subscribe: Python ----------
import time
import logging
import datetime
import Grasshopper
from roslibpy import Topic
from scriptcontext import sticky

LOGGER = logging.getLogger('roslibpy')
key = 'listener_obj_poses'
#print key

if subscribe_to_topic:
    if ros_client and ros_client.is_connected:
        print("subscribed to topic")
        #listener = Topic(ros_client, '/incon/object_pose', 'geometry_msgs/PoseStamped', compression=None, latch=False, throttle_rate=0, queue_size=15, queue_length=3)
        listener = Topic(ros_client, '/incon/object_poses', 'incon_msgs/PoseStampedArray')
        sticky[key] = listener
    else:
        sticky[key] = None
else:
    sticky[key] = None
# ---------- end subscribe ----------
panel_3 = Panel(subscribe)

# ----
# TOPIC LISTENER
listening = GhPythonScript(bang=bang_2, start_timer=start_timer, stop_timer=stop_timer)  # -> out, elem_frame, frame_id, bang_sound
# ---------- listening: Python ----------
from scriptcontext import sticky
from compas_ghpython.utilities import update_component
from compas.geometry import Frame


guid = str(ghenv.Component.InstanceGuid)
timer_running_key = "timer_running_" + guid
counter_key = "counter_" + guid

if stop_timer or timer_running_key not in sticky:
    sticky[timer_running_key] = False
    sticky[counter_key] = 0

if start_timer:
    sticky[timer_running_key] = True
    sticky[counter_key] = 0
    

if sticky[timer_running_key]:
    update_component(ghenv, 1000)
    
    sticky[counter_key] += 1
    print(sticky[counter_key])


def receive_message_object_poses(message):
    #sticky['message'] = str(datetime.datetime.now()) + ': ' + str(message)
    #print("receiving")
    sticky['incon_msg_obj_poses'] = message


"""
if 'incon_msg_obj_pose' in sticky:   
    if sticky['incon_msg_obj_pose']:
        
        incon_msg_obj_pose = sticky['incon_msg_obj_pose']
        p = incon_msg_obj_pose['pose']
        frame_id = eval(incon_msg_obj_pose['header']['frame_id'])
        added_elem_frame = Frame.from_quaternion([p['orientation']['w'],p['orientation']['x'], p['orientation']['y'], p['orientation']['z']], point = [p['position']['x'], p['position']['y'], p['position']['z']] )
        print('++ Listening to INCON MSG OBJECT POSE')
        
        #print added_elem_frame
        #print frame_id
    else:
        print('NOT listening to INCON MSG OBJECT POSE')
"""

if 'listener_obj_poses' in sticky:
    if sticky['listener_obj_poses']:
    
        listener_obj_poses = sticky['listener_obj_poses']
        listener_obj_poses.subscribe(receive_message_object_poses)
    
        if 'incon_msg_obj_poses' in sticky and sticky['incon_msg_obj_poses']:
            #bang = True 
            
            incon_msg_obj_poses = sticky['incon_msg_obj_poses']
            print("amount of object placed:" + " " + str(len(incon_msg_obj_poses['poses'])))
            if len(incon_msg_obj_poses['poses']):
                last_element = incon_msg_obj_poses['poses'][0]
                p = last_element ['pose']
                frame_id = eval(last_element['header']['frame_id'])
                elem_frame = Frame.from_quaternion([p['orientation']['w'],p['orientation']['x'], p['orientation']['y'], p['orientation']['z']], point = [p['position']['x'], p['position']['y'], p['position']['z']] )

                print('++ Listening to INCON MSG OBJECT POSES')
                print('frame_id: ', frame_id)
    
        else:
            bang = False
            print('NOT receiving INCON MSG OBJECT POSES')
    else:
        print('NOT listening to INCON MSG OBJECT POSES')
        
#bang = True if bang else False
    
print elem_frame
# ---------- end listening ----------
panel_4 = Panel(listening.out)

# ----
# Visualise the defined element
panel_5 = Panel("0.05")
show = BooleanToggle(True)
box = CenterBox(Base=PlaneXY(0, 0, 0), X=panel_5, Y=panel_5, Z=panel_5)

# ----
# Element
mesh = Mesh(box)
pln = Plane(PlaneXY(0, 0, 0))
python = GhPythonScript(rmesh=mesh, center_plane=pln)  # -> out, elem; inputs rmesh: Mesh
# ---------- python: Python ----------
from compas_rhino.geometry import RhinoMesh
from compas.datastructures import Mesh

from compas_ghpython.artists import MeshArtist

from assembly_information_model.assembly import Element
from compas.geometry import Frame



cmesh = RhinoMesh.from_geometry(rmesh).to_compas()
#print cmesh
tool_frame = Frame(center_plane.Origin, center_plane.XAxis, center_plane.YAxis)
elem = Element.from_mesh(cmesh, tool_frame)

print(elem.tool_frame)
# ---------- end python ----------

draw = PythonScript(elem=python.elem, show=show)  # -> M, F, S
# ---------- draw: Python ----------
import os
from compas.geometry import Transformation
from compas.geometry import Frame
from compas.datastructures import mesh_transformed
from compas_ghpython.artists import MeshArtist
from compas_ghpython import draw_frame

if show:
    artist = MeshArtist(elem.mesh)
    M = artist.draw()
    F = draw_frame(elem.frame)
# ---------- end draw ----------
preview = CustomPreview(Geometry=draw.M, Shader=ColourSwatch(SwatchColor=RGBA(255, 227, 227, 233)))

# ----
# Export rhino mesh
panel_6 = Panel("box_lidia.obj")
py = PythonScript()  # -> HERE, DATA
# ---------- py: Python ----------
import os
from scriptcontext import sticky as st

HERE = os.path.dirname(ghdoc.Path)
DATA = os.path.abspath(os.path.join(HERE, "..", "data"))
print(HERE)
print(DATA)

st.clear()
st['DATA_PATH'] = DATA
# ---------- end py ----------
export = GhPythonScript(DATA=py.DATA, elem=python.elem, filename=panel_6, export_to_obj=Button())  # inputs export_to_obj: Boolean
# ---------- export: Python ----------
import os

if export_to_obj:
    elem.mesh.quads_to_triangles(check_angles=False)
    #filename = "element_example.obj"
    PATH = os.path.join(DATA, filename)
    elem.mesh.to_obj(PATH, precision=None, unweld=False)
# ---------- end export ----------

# ----
# Assembly
create_assembly = GhPythonScript(elem=python.elem, planes=pl)  # -> assembly; inputs planes: list of Plane
# ---------- create_assembly: Python ----------
from compas_rhino.geometry import RhinoMesh
from compas.datastructures import Mesh

from compas_ghpython.artists import MeshArtist

from assembly_information_model.assembly import Element
from assembly_information_model.assembly import Assembly
from compas.geometry import Frame, Transformation

assembly = Assembly()

for plane in planes:
    tool_frame = Frame(plane.Origin, plane.XAxis, plane.YAxis)
    T = Transformation.from_frame(tool_frame)
    new_elem = elem.transformed(T)
    assembly.add_element(new_elem)

for key, element in assembly.elements():
     element.frame_id=None
     print(element.frame_id)
# ---------- end create_assembly ----------

# ----
# Draw
counter = CountThroughList(assembly=create_assembly, start=start, stop=stop, step=step, step_back=back, reset=reset, full=full, interval=list_2)  # -> item, counter; inputs start: Boolean, stop: Boolean, step_back: Boolean
# ---------- counter: Python ----------
from scriptcontext import sticky as st
from compas_ghpython import update_component


L = list(assembly.elements())
# store data in component
guid = str(ghenv.Component.InstanceGuid)
counter_key = "counter_" + guid
running_key = "running_" + guid

if counter_key not in st:
    st[counter_key] = 0

if running_key not in st:
    st[running_key] = False
    

if st[running_key]:
    if st[counter_key] < len(L) - 1:
        st[counter_key] += 1
        update_component(ghenv, interval)
    else:
        st[counter_key] = 0
        st[running_key] = False
    
    
if start:
    st[running_key] = True

if stop:
    st[running_key] = False

if step:
    if st[counter_key] < len(L) - 1:
        st[counter_key] += 1

if step_back:
    if st[counter_key] < len(L):
        st[counter_key] -= 1

if reset:
    st[counter_key] = 0

if full:
    st[counter_key] = len(L)-1

if len(L):
    item = L[st[counter_key]]



#st["visualisation_counter"] = st[counter_key]
counter = st[counter_key]
# ---------- end counter ----------
show_2 = BooleanToggle(False)
show_3 = BooleanToggle(False)
idx = Panel(counter.counter)
draw_2 = PythonScript(assembly=create_assembly, show_all=show_2, show_counter=show_3, counter=idx)  # -> G, origin_planes_WCS, current_origin_plane; inputs counter: Int32
# ---------- draw_2: Python ----------
import os
import sys

import math

from compas_ghpython.artists import MeshArtist
from compas_ghpython import draw_frame


G = []

key_index = assembly.network.key_index()
keys = [key_index[key] for key in assembly.network.nodes()]
elements = [assembly.element(key) for key in keys]
#print elements
#print([(e.gripping_frame) for e in elements])

origin_planes_WCS = [draw_frame(e.frame) for e in elements]

current_origin_plane = origin_planes_WCS[counter]

if show_all and not show_counter:
    for element in elements:
        artist = MeshArtist(element.mesh)
        mesh = artist.draw()
        G.append(mesh)

if show_counter:
    for element in elements[0:counter+1]:
        artist = MeshArtist(element.mesh)
        mesh = artist.draw()
        G.append(mesh)
    origin_planes_WCS = [draw_frame(e.frame) for e in elements[0:counter+1]]
# ---------- end draw_2 ----------
pln_2 = Plane(draw_2.origin_planes_WCS)
pln_3 = Plane(draw_2.current_origin_plane)
geo = Geometry(draw_2.G)
preview_2 = CustomPreview(Geometry=geo, Shader=ColourSwatch(SwatchColor=RGBA(255, 227, 227, 233)))
preview_3 = CustomPreview(Geometry=[pln_2, pln_3], Shader=ColourSwatch(SwatchColor=RGBA(209, 27, 27, 178)))

# ----
# Rhino to App:
# Service: ADD Building Steps
number_slider_2 = Slider(1, range=0..10)
# 3.
panel_7 = Panel("box_lidia")
ros_service_request = PythonScript(
    ros_client=connect_2.ros_client,
    assembly=create_assembly,
    object_type=panel_7,
    num_built_elems=number_slider_2,
    send=Button())  # -> out, assembly, bang; inputs num_built_elems: Int32, send: Boolean
# ---------- ros_service_request: Python ----------
import logging
import roslibpy
from roslibpy import Topic
from roslibpy import ServiceRequest
from roslibpy import Service
from roslibpy import Message
from scriptcontext import sticky


LOGGER = logging.getLogger('roslibpy') 


def ros_msg_add_building_steps():
    ros_msg = {}
    building_steps = []
    for key, element, data in assembly.elements(data=True):
        x,y,z,qw,qx,qy,qz = element.tool_frame_pose_quaternion
        if key < num_built_elems:
            is_already_built = True  #data['is_placed']
        else:
            is_already_built = False
        building_steps.append({'pose': {'orientation': {'z': qz, 'y': qy, 'x': qx, 'w': qw}, 'position': {'z': z, 'y': y, 'x': x}},'object_type': object_type, 'is_already_built': is_already_built})
    ros_msg['building_steps'] = building_steps
    return ros_msg


if send:
    print("send")
    if ros_client:
            message = ros_msg_add_building_steps() #geometry_msgs/PoseStamped[] 
            #message = handle_add_two_bricks()[0] #geometry_msgs/PoseStamped[] 
            #print (message)                
            service_name = '/incon/add_building_steps'
            service_type = '/incon_msgs/add_building_steps'
            service = roslibpy.Service(ros_client, service_name, service_type)
            request = ServiceRequest(message)
            result = service.call(request, timeout=1) #sending of message
            #print(result)
            sticky['result_add_objects'] = result
            
            
            if result:
                # set the frame_id as received from the app
                is_added, num_building_steps_added = (result['success'], result['num_building_steps_added'])
                print(is_added)
                print(num_building_steps_added)
                    
                bang = True if result['success'] == True else False

if 'result_add_objects' in sticky:
    print sticky['result_add_objects']
# ---------- end ros_service_request ----------
panel_8 = Panel(ros_service_request.out)

show_4 = BooleanToggle(True)
python_2 = GhPythonScript(frame=listening.elem_frame, elem=python.elem, show=show_4)  # -> out, plane, element
# ---------- python_2: Python ----------
import Rhino.Geometry as rg
from compas.geometry import Transformation
from compas_ghpython import draw_frame
from compas_ghpython.artists import MeshArtist

plane = draw_frame(frame)

T = Transformation.from_frame(frame)
new_elem = elem.transformed(T) 

if show:
    artist = MeshArtist(new_elem.mesh)
    element = artist.draw()
# ---------- end python_2 ----------
pln_4 = Plane(python_2.plane)
mesh_2 = Mesh(python_2.element)
preview_4 = CustomPreview(Geometry=mesh_2, Shader=ColourSwatch(SwatchColor=RGB(255, 38, 36)))
