# Grasshopper definition ex6_triangulated_mesh.ghx (Grasshopper 1.0.7)

mesh = Mesh(<mesh referenced from the Rhino model>)
mesh_offset_extrude = MeshOffsetExtrude(M=mesh, B=Toggle(True), E=Toggle(True), C0=Toggle(True), C1=Toggle(True), D=Slider(-0.007, range=-1..1))  # -> out, A; inputs M: Mesh, V: list of Vector3d, D: list
# ---------- mesh_offset_extrude: VB ----------
    Component.Params.Input(0).Name = "Mesh"
    Component.Params.Input(0).Description = "Open or closed mesh"
    Component.Params.Input(1).Name = "Both Sides"
    Component.Params.Input(1).Description = "If true the mesh is offset in both directions along the vertex normals"
    Component.Params.Input(2).Name = "Edges"
    Component.Params.Input(2).Description = "If true the mesh will contain faces on the edges between the two offset mesh faces"
    Component.Params.Input(3).Name = "Closed Bottom"
    Component.Params.Input(3).Description = "If true the mesh will be closed on the origin face"
    Component.Params.Input(4).Name = "Closed Top"
    Component.Params.Input(4).Description = "If true the mesh will be closed on the offset face"
    Component.Params.Input(5).Name = "Vector [Vertex]"
    Component.Params.Input(5).Description = "An optional vector that sets the direction of extrusion, if empty, the new mesh will be offset along the vertex normals"
    Component.Params.Input(6).Name = "Distance [Vertex, Rh Units]"
    Component.Params.Input(6).Description = "A single number or list of numbers corresponding to each vertex of a mesh which sets the Rhino unit based distance that the new geometry is offset from each mesh face"

    Component.Params.Output(1).Name = "Mesh"
    Component.Params.Output(1).Description = "If successful, a valid mesh"

    If m IsNot Nothing Then

      Dim mf As Rhino.Geometry.Collections.MeshFaceList = Nothing
      Dim mv As Rhino.Geometry.Collections.MeshVertexList = Nothing
      Dim mtv As Rhino.Geometry.Collections.MeshTopologyVertexList = Nothing
      Dim mte As Rhino.Geometry.Collections.MeshTopologyEdgeList = Nothing
      Dim mn As Rhino.Geometry.Collections.MeshVertexNormalList = Nothing
      Dim mc As Rhino.Geometry.Collections.MeshVertexColorList = Nothing

      mf = m.Faces
      mv = m.Vertices
      mtv = m.TopologyVertices
      mte = m.TopologyEdges
      mn = m.Normals
      mc = m.VertexColors

      Dim clrB As Boolean = False
      If mc.count() > 0 Then clrB = True

      Dim i,cv,cf,u(1),hd As Integer
      Dim blnV As Boolean
      Dim vec As vector3d
      Dim ova, ovb As New list(Of point3d)
      Dim vf As New list(Of Vector3f)
      Dim ofc As New list(Of MeshFace)
      If b Then hd = 2 Else hd = 1
      
      cv = mv.count()
      cf = mf.count()

      If (D.count() - 1) < cv Then D = matchDbl(D, cv)

      If v.count() > 0 Then
        blnV = True
        If (V.count() - 1) < cv Then V = matchVec(V, cv)
      End If

      'Define Base Vertices
      For i = 0 To cv - 1 Step 1
        If blnV Then vec = V(i) Else vec = mn(i)
        vec.Unitize()
        vec *= (D(i) / hd)

        ovb.add(New point3d(mv(i)) + vec)
        If Not b Then vec *= 0
        vec.Reverse()
        ova.add(New point3d(mv(i)) + vec)
      Next

      If (c0 Or (((Not c0) And (Not e)) And c1)) Then ofc = mf.ToList()

      If ((e or c0) And c1) Then
        For i = 0 To cf - 1 Step 1
          If mf(i).isquad() Then
            ofc.add(New meshface(mf(i).A + cv, mf(i).B + cv, mf(i).C + cv, mf(i).D + cv))
          Else
            ofc.add(New meshface(mf(i).A + cv, mf(i).B + cv, mf(i).C + cv))
          End If
        Next
      End If

      If e Then
        For i = 0 To mte.count() - 1 Step 1

          u(0) = mtv.MeshVertexIndices(mte.GetTopologyVertices(i).I)(0)
          u(1) = mtv.MeshVertexIndices(mte.GetTopologyVertices(i).J)(0)

          If uBound(mte.GetConnectedFaces(i)) < 1 Then
            ofc.add(New meshface(u(0), u(1), u(1) + cv, u(0) + cv))
          End If
        Next
      End If

      Dim mo As New mesh

      If (c0 Or e) Then
        mo.Vertices.AddVertices(ova.toarray())
        If clrB Then mo.VertexColors.AppendColors(mc.ToArray())
      End If
      If (c1 Or e) Then
        mo.Vertices.AddVertices(ovb.toarray())
        If clrB Then mo.VertexColors.AppendColors(mc.ToArray())
      End If

      mo.Faces.AddFaces(ofc)

      A = mo
    End If
# ---------- mesh_offset_extrude: VB additional code ----------
  Private Function matchDbl(ByVal a As list(Of Double), ByVal t As Integer)
    Dim i,k As Integer
    k = a.count()
    For i = 0 To ((t + 1) - k) - 1 Step 1
      a.add(a.item(k - 1))
    Next
    Return a
  End Function

  Private Function matchVec(ByVal a As list(Of vector3d), ByVal t As Integer)
    Dim i,k As Integer
    k = a.count()
    For i = 0 To ((t + 1) - k) - 1 Step 1
      a.add(a.item(k - 1))
    Next
    Return a
  End Function
# ---------- end mesh_offset_extrude ----------

# ----
# Plane from mesh face
mesh_2 = Mesh([<mesh referenced from the Rhino model> x4])
planes = GhPythonScript(mfaces=mesh_2)  # -> planes; inputs mfaces: list of Mesh
# ---------- planes: Python ----------
import rhinoscriptsyntax as rs
import Rhino.Geometry as rg
from compas.geometry import cross_vectors
from compas.geometry import Vector, Frame
from compas_ghpython.utilities import draw_frame

planes = []

for mesh in mfaces:
    # vertex 0 and 1
    vertex1 = rs.MeshVertices(mesh)[0]
    vertex2 = rs.MeshVertices(mesh)[1]
    
    # set the origin of the plane in the middle of vertex 0 and 1
    origin = (rs.MeshVertices(mesh)[0]+rs.MeshVertices(mesh)[1])/2.0
    
    # compute x_axis vector
    x_axis = Vector(vertex1[0],vertex1[1], vertex1[2]) - Vector(vertex2[0],vertex2[1], vertex2[2])
    
    # extract face normal
    face_normal = Vector(rs.MeshFaceNormals(mesh)[0][0], rs.MeshFaceNormals(mesh)[0][1], rs.MeshFaceNormals(mesh)[0][2])
    
    # compute y_axis as cross product of x_axis and the face normal
    y_axis = cross_vectors(x_axis, face_normal)
    
    # append planes to a list
    planes.append(draw_frame(Frame(origin, x_axis, y_axis)))
# ---------- end planes ----------
pln = Plane(planes)

# ----
# 2.
# Assembly Example
number_slider = Slider(6, range=0..10)  # disabled
crv = Curve(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)  # disabled
divide = DivideCurve(Curve=crv, Count=number_slider, Kinks=False)  # -> Points, Tangents, Parameters; disabled
Z = UnitZ(Factor=1)  # disabled
xprod = CrossProduct(VectorA=divide.Tangents, VectorB=Z, Unitize=False)  # -> Vector, Length; disabled
pl = ConstructPlane(Origin=divide.Points, XAxis=xprod.Vector, YAxis=Vector(0, 1, 0))  # disabled

# ----
# 1.
bang = Button()
panel = Panel("Unload libraries")
unload = PythonScript(bang=bang)
# ---------- unload: Python ----------
from compas_rhino.utilities.misc import get_tolerance
from compas_rhino.utilities.misc import unload_modules

unload_modules("compas")
unload_modules("assembly_information_model")
# ---------- end unload ----------

# ----
# ROS - Settings
list = ValueList({"local": 0, "linux computer": 1}, selected="local")

# ---- group: ROS client
restart = Button()
disconnect = Button()
connect = Button()
ros = PythonScript(restart=restart, connection=list)  # -> ros_client
# ---------- ros: Python ----------
import time
import logging
import scriptcontext as sc

from roslibpy import Ros
from System import TimeSpan
from System.Threading import ManualResetEventSlim

LOGGER = logging.getLogger('roslibpy')

guid = str(ghenv.Component.InstanceGuid)
ros_client_key = "rosclient_" + guid

previous_client = sc.sticky.get(ros_client_key, None)
if previous_client:
    previous_client.terminate()

if connection == 0: #local
    ros_client = Ros('127.0.0.1', 9090) #local, own laptop
elif connection == 1: # linux computer
    ros_client = Ros('192.168.2.106', 9090) #mabi computer - lan
sc.sticky[ros_client_key] = ros_client

waitLock = ManualResetEventSlim(False) 
ros_client.on_ready(lambda: waitLock.Set()) 

if not waitLock.Wait(TimeSpan.FromSeconds(5)):
    raise Exception('Unable to connect to ROS')

LOGGER.info('ROS connection opened')
# ---------- end ros ----------
connect_2 = PythonScript(ros_client=ros, connect=connect, disconnect=disconnect)  # -> out, ros_client
# ---------- connect_2: Python ----------
import logging
from System import TimeSpan
from System.Threading import ManualResetEventSlim

LOGGER = logging.getLogger('roslibpy')

if connect:
    if not ros_client.is_connected:
        LOGGER.debug('Connecting...')
        waitLock = ManualResetEventSlim(False)
        ros_client.on_ready(lambda: waitLock.Set())
        ros_client.connect()

        if not waitLock.Wait(TimeSpan.FromSeconds(5)):
            raise Exception('Unable to connect to ROS')
        LOGGER.debug('Reconnected')

if disconnect:
    if ros_client.is_connected:
        ros_client.terminate()
        LOGGER.debug('Terminated')
        
       
if (ros_client.is_connected):
    print('connected')
else:
    print('disconnected')
# ---------- end connect_2 ----------
panel_2 = Panel(connect_2.out)

# ----
back = Button()
reset = Button()
start = Button()
stop = Button()
step = Button()
full = Button()
list_2 = ValueList({"20", "50", "100", "500", "1000", "5000"}, selected="50")

# ----
# Visualise the defined element
panel_3 = Panel("0.05")  # disabled
show = BooleanToggle(True)
box = CenterBox(Base=PlaneXY(0, 0, 0), X=panel_3, Y=panel_3, Z=panel_3)  # disabled

# ----
# Element
pln_2 = Plane(PlaneXY(0, 0, 0))
mesh_3 = Mesh(box)  # disabled
python = GhPythonScript(rmesh=mesh_offset_extrude.A, center_plane=pln_2)  # -> out, elem; inputs rmesh: Mesh
# ---------- python: Python ----------
from compas_rhino.geometry import RhinoMesh
from compas.datastructures import Mesh

from compas_ghpython.artists import MeshArtist

from assembly_information_model.assembly import Element
from compas.geometry import Frame



cmesh = RhinoMesh.from_geometry(rmesh).to_compas()
#print cmesh
tool_frame = Frame(center_plane.Origin, center_plane.XAxis, center_plane.YAxis)
elem = Element.from_mesh(cmesh, tool_frame)

print(elem.tool_frame)
# ---------- end python ----------

draw = PythonScript(elem=python.elem, show=show)  # -> M, F, S
# ---------- draw: Python ----------
import os
from compas.geometry import Transformation
from compas.geometry import Frame
from compas.datastructures import mesh_transformed
from compas_ghpython.artists import MeshArtist
from compas_ghpython import draw_frame

if show:
    artist = MeshArtist(elem.mesh)
    M = artist.draw()
    F = draw_frame(elem.frame)
# ---------- end draw ----------
preview = CustomPreview(Geometry=draw.M, Shader=ColourSwatch(SwatchColor=RGBA(255, 227, 227, 233)))

# ----
# Export rhino mesh
panel_4 = Panel("triangle.obj")
py = PythonScript()  # -> HERE, DATA
# ---------- py: Python ----------
import os
from scriptcontext import sticky as st

HERE = os.path.dirname(ghdoc.Path)
DATA = os.path.abspath(os.path.join(HERE, "..", "data"))
print(HERE)
print(DATA)

st.clear()
st['DATA_PATH'] = DATA
# ---------- end py ----------
export = GhPythonScript(DATA=py.DATA, elem=python.elem, filename=panel_4, export_to_obj=Button())  # inputs export_to_obj: Boolean
# ---------- export: Python ----------
import os

if export_to_obj:
    elem.mesh.quads_to_triangles(check_angles=False)
    #filename = "element_example.obj"
    PATH = os.path.join(DATA, filename)
    elem.mesh.to_obj(PATH, precision=None, unweld=False)
# ---------- end export ----------

# ----
# Assembly
create_assembly = GhPythonScript(elem=python.elem, planes=pln)  # -> assembly; inputs planes: list of Plane
# ---------- create_assembly: Python ----------
from compas_rhino.geometry import RhinoMesh
from compas.datastructures import Mesh

from compas_ghpython.artists import MeshArtist

from assembly_information_model.assembly import Element
from assembly_information_model.assembly import Assembly
from compas.geometry import Frame, Transformation

assembly = Assembly()

for plane in planes:
    tool_frame = Frame(plane.Origin, plane.XAxis, plane.YAxis)
    T = Transformation.from_frame(tool_frame)
    new_elem = elem.transformed(T)
    assembly.add_element(new_elem)
# ---------- end create_assembly ----------

preview_2 = CustomPreview(Geometry=draw.F, Shader=ColourSwatch(SwatchColor=RGBA(209, 27, 27, 178)))

# ----
# Draw
counter = CountThroughList(assembly=create_assembly, start=start, stop=stop, step=step, step_back=back, reset=reset, full=full, interval=list_2)  # -> item, counter; inputs start: Boolean, stop: Boolean, step_back: Boolean
# ---------- counter: Python ----------
from scriptcontext import sticky as st
from compas_ghpython import update_component


L = list(assembly.elements())
# store data in component
guid = str(ghenv.Component.InstanceGuid)
counter_key = "counter_" + guid
running_key = "running_" + guid

if counter_key not in st:
    st[counter_key] = 0

if running_key not in st:
    st[running_key] = False
    

if st[running_key]:
    if st[counter_key] < len(L) - 1:
        st[counter_key] += 1
        update_component(ghenv, interval)
    else:
        st[counter_key] = 0
        st[running_key] = False
    
    
if start:
    st[running_key] = True

if stop:
    st[running_key] = False

if step:
    if st[counter_key] < len(L) - 1:
        st[counter_key] += 1

if step_back:
    if st[counter_key] < len(L):
        st[counter_key] -= 1

if reset:
    st[counter_key] = 0

if full:
    st[counter_key] = len(L)-1

if len(L):
    item = L[st[counter_key]]



#st["visualisation_counter"] = st[counter_key]
counter = st[counter_key]
# ---------- end counter ----------
show_2 = BooleanToggle(True)
show_3 = BooleanToggle(False)
idx = Panel(counter.counter)
draw_2 = PythonScript(assembly=create_assembly, show_all=show_2, show_counter=show_3, counter=idx)  # -> G, origin_planes_WCS, current_origin_plane; inputs counter: Int32
# ---------- draw_2: Python ----------
import os
import sys

import math

from compas_ghpython.artists import MeshArtist
from compas_ghpython import draw_frame


G = []

key_index = assembly.network.key_index()
keys = [key_index[key] for key in assembly.network.nodes()]
elements = [assembly.element(key) for key in keys]
#print elements
#print([(e.gripping_frame) for e in elements])

origin_planes_WCS = [draw_frame(e.frame) for e in elements]

current_origin_plane = origin_planes_WCS[counter]

if show_all and not show_counter:
    for element in elements:
        artist = MeshArtist(element.mesh)
        mesh = artist.draw()
        G.append(mesh)

if show_counter:
    for element in elements[0:counter+1]:
        artist = MeshArtist(element.mesh)
        mesh = artist.draw()
        G.append(mesh)
    origin_planes_WCS = [draw_frame(e.frame) for e in elements[0:counter+1]]
# ---------- end draw_2 ----------
pln_3 = Plane(draw_2.origin_planes_WCS)
pln_4 = Plane(draw_2.current_origin_plane)
geo = Geometry(draw_2.G)
preview_3 = CustomPreview(Geometry=geo, Shader=ColourSwatch(SwatchColor=RGBA(255, 227, 227, 233)))
preview_4 = CustomPreview(Geometry=[pln_3, pln_4], Shader=ColourSwatch(SwatchColor=RGBA(209, 27, 27, 178)))

# ----
# Rhino to App:
# Service: ADD Building Steps
number_slider_2 = Slider(1, range=0..10)
# 3.
panel_5 = Panel("triangle")
ros_service_request = PythonScript(
    ros_client=connect_2.ros_client,
    assembly=create_assembly,
    object_type=panel_5,
    num_built_elems=number_slider_2,
    send=Button())  # -> out, assembly, bang; inputs num_built_elems: Int32, send: Boolean
# ---------- ros_service_request: Python ----------
import logging
import roslibpy
from roslibpy import Topic
from roslibpy import ServiceRequest
from roslibpy import Service
from roslibpy import Message
from scriptcontext import sticky


LOGGER = logging.getLogger('roslibpy') 


def ros_msg_add_building_steps():
    ros_msg = {}
    building_steps = []
    for key, element, data in assembly.elements(data=True):
        x,y,z,qw,qx,qy,qz = element.tool_frame_pose_quaternion
        if key < num_built_elems:
            is_already_built = True  #data['is_placed']
        else:
            is_already_built = False
        building_steps.append({'pose': {'orientation': {'z': qz, 'y': qy, 'x': qx, 'w': qw}, 'position': {'z': z, 'y': y, 'x': x}},'object_type': object_type, 'is_already_built': is_already_built})
    ros_msg['building_steps'] = building_steps
    return ros_msg


if send:
    print("send")
    if ros_client:
            message = ros_msg_add_building_steps() #geometry_msgs/PoseStamped[] 
            #message = handle_add_two_bricks()[0] #geometry_msgs/PoseStamped[] 
            #print (message)                
            service_name = '/incon/add_building_steps'
            service_type = '/incon_msgs/add_building_steps'
            service = roslibpy.Service(ros_client, service_name, service_type)
            request = ServiceRequest(message)
            result = service.call(request, timeout=1) #sending of message
            #print(result)
            sticky['result_add_objects'] = result
            
            
            if result:
                # set the frame_id as received from the app
                is_added, num_building_steps_added = (result['success'], result['num_building_steps_added'])
                print(is_added)
                print(num_building_steps_added)
                    
                bang = True if result['success'] == True else False

if 'result_add_objects' in sticky:
    print sticky['result_add_objects']
# ---------- end ros_service_request ----------
panel_6 = Panel(ros_service_request.out)
